# Grasshopper definition material_deconstruct.gh (Grasshopper 1.0.7)
# plug-ins: Bifocals

opaquematnomass = HBOpaqueMaterialNoMass(r_value="4")  # -> mat; plug-in component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
searchconstrs = HBSearchConstructions(keywords="exterior mass wall")  # -> opaque_constrs, window_constrs, shade_constrs; plug-in component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
opaqueconstr = HBOpaqueConstruction(name="wall_constr", materials=opaquematnomass)  # -> constr; plug-in component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
panel = Panel(searchconstrs.opaque_constrs)
decnstrconstr = HBDeconstructConstruction(constr=opaqueconstr)  # -> materials, layers, r_val_si, r_val_ip, u_fac_si, u_fac_ip, t_sol, t_vis; plug-in component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
panel_2 = Panel(decnstrconstr.r_val_si)
item = ListItem(List=searchconstrs.opaque_constrs, Index=0, Wrap=True)
decnstrconstr_2 = HBDeconstructConstruction(constr=searchconstrs.opaque_constrs)  # -> materials, layers, r_val_si, r_val_ip, u_fac_si, u_fac_ip, t_sol, t_vis; plug-in component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
panel_3 = Panel(decnstrconstr_2.r_val_si)
